# Grasshopper definition GH SAP Components_.gh (Grasshopper 0.9.76)
# plug-ins: Kangaroo2 Components

crv = Curve([<curve referenced from the Rhino model> x3])
pt = Point([<point referenced from the Rhino model> x4])
crv_2 = Curve(<curve referenced from the Rhino model>)
custom_mesh_settings = SettingsCustom(
    StitchSeams=True,
    SimplePlanes=False,
    Refine=True,
    MinCount=16,
    MaxCount=400,
    AspectRatio=20,
    MaxDistance=0,
    MaxAngle=20,
    MinEdge="2",
    MaxEdge="2")
loft = Loft(Curves=crv, Options={Adjust=False, Closed=False, LoftEnds=0, LoftSimp=0, LoftType=0, Rebuild=10, Refit=0.01})
boundary = BoundarySurfaces(Edges=crv_2)
mesh = MeshBrep(Brep=boundary, Settings=custom_mesh_settings)
medges = MeshEdges(Mesh=mesh)  # -> NakedEdges, InteriorEdges, NonManifoldEdges
demesh = DeconstructMesh(Mesh=mesh)  # -> Vertices, Faces, Colours, Normals
crv_3 = Curve([medges.NakedEdges, medges.InteriorEdges])
len = Length(Curve=crv_3)
toggle = BooleanToggle(True)
multiplication = Multiplication(A=len, B=Slider(0.78, range=0..2))
cp = ClosestPoint(Point=pt, Cloud=demesh.Vertices)  # -> ClosestPoint, CPIndex, Distance
Z = UnitZ(Factor=Slider(1, range=-10..10))
length_line = LengthLine(Line=crv_3, Length=multiplication, Strength=10)
anchor = Anchor(Point=cp.ClosestPoint, Strength=10000)
anchorxyz = AnchorXYZ(Point=demesh.Vertices, X=toggle, Y=toggle, Z=False, Strength=1000)
load = Load(Point=demesh.Vertices, ForceVector=Z)
show = Show(G=mesh)
zombiesolver = ZombieSolver(GoalObjects=[length_line, anchor, load, anchorxyz, show], Threshold=1e-10, Tolerance=0.01, MaxIterations="1000")  # -> I, V, O
mesh_2 = Mesh(zombiesolver.O)
clean = CleanTree(RemoveNulls=True, RemoveInvalid=True, RemoveEmpty=False, Tree=mesh_2)
demesh_2 = DeconstructMesh(Mesh=clean)  # -> Vertices, Faces, Colours, Normals
deface = DeconstructFace(Face=graft(demesh_2.Faces))  # -> CornerA, CornerB, CornerC, CornerD
getsap20 = VBScript(run=Button(), Reference="C:\Program Files (x86)\Computers and Structures\SAP2000 20\SAP2000v20.dll")  # -> out, SapModel
# ---------- getsap20: VB ----------
    If run Then

      ' - attach to running SAP - - - - - - - - - - - - - - - - - - - - - - - - -
      'BV_Model10_R8.sdb

      Dim mySapObject As cOAPI
      mySapObject = Nothing

      'attach to a running instance of Sap2000
      'get the active Sap2000 object
      mySapObject = GetObject(, "CSI.SAP2000.API.SapObject")
      AppActivate("SAP2000")

      'Get a reference to cSapModel to access all OAPI classes and functions
      'Dim mySapModel As cSapModel
      mySapModel = mySapObject.SapModel

    End If


    SapModel_ = mySapModel
# ---------- getsap20: VB additional code ----------
  Private Shared mySapModel As cSapModel
# ---------- end getsap20 ----------
item = ListItem(List=demesh_2.Vertices, Index=[deface.CornerA, deface.CornerB, deface.CornerC, deface.CornerD], Wrap=True)  # -> simplify(Item)
item_2 = ListItem(List=demesh_2.Vertices, Index=deface.CornerA, Wrap=True)
item_3 = ListItem(List=demesh_2.Vertices, Index=deface.CornerB, Wrap=True)
item_4 = ListItem(List=demesh_2.Vertices, Index=deface.CornerD, Wrap=True)
item_5 = ListItem(List=demesh_2.Vertices, Index=deface.CornerC, Wrap=True)
unlock = VBScript(
    SapModel=getsap20.SapModel,
    run=clean,
    Reference="C:\Program Files (x86)\Computers and Structures\SAP2000 20\SAP2000v20.dll")  # -> out, A
# ---------- unlock: VB ----------
    Dim mySapModel As csapmodel
    mySapModel = CType(_SapModel, cSapModel)
    Dim ret As Long


    ' - - - - - - - - - - - - - - - - - - - - - + - - - + - - - + - - - + - - - +
    ret = mySapModel.SetModelIsLocked(False)

    'End If

    A = ret
# ---------- end unlock ----------
srf4pt = _4PointSurface(CornerA=item_2, CornerB=item_3, CornerC=item_5, CornerD=item_4)
addareascoord = VBScript(
    SapModel=getsap20.SapModel,
    Faces=item,
    run=unlock.A,
    Reference="C:\Program Files (x86)\Computers and Structures\SAP2000 20\SAP2000v20.dll")  # -> out, AreaNames, A; inputs Faces: tree of Point3d
# ---------- addareascoord: VB ----------
    Dim mySapModel As csapmodel
    mySapModel = CType(_SapModel, cSapModel)
    Dim ret As Long

    'If run Then
    AreaNames.clear
    ret = Nothing

    'Delete all existing areas
    Dim NumberNames As Long = Nothing
    Dim OldAreaNames() As String = Nothing
    ret = mySapModel.AreaObj.GetNameList(NumberNames, OldAreaNames)
    For i As Integer = 0 To NumberNames - 1
      ret = mySapModel.AreaObj.Delete(OldAreaNames(i))
      print(ret)
      print(OldAreaNames(0))
    Next


    For i As Integer = 0 To _Faces.BranchCount() - 1
      Dim areaname As String = Nothing
      Dim x() As Double
      Dim y() As Double
      Dim z() As Double
      ReDim x(5)
      ReDim y(5)
      ReDim z(5)
      'ret = mySapModel.AreaObj.AddByPoint(4, _Faces.Branch(i).ToArray(), areaname)
      Dim fpts() as Rhino.Geometry.Point3d
      fpts = _Faces.Branch(i).ToArray
      For ii As Integer = 0 To 3
        x(ii) = fpts(ii).x
        y(ii) = fpts(ii).y
        z(ii) = fpts(ii).z
      Next
      x(4) = fpts(0).x
      y(4) = fpts(0).y
      z(4) = fpts(0).z

      ret = mySapModel.AreaObj.AddByCoord(4, x, y, z, areaname)
      AreaNames.add(areaname)
      'print(ret)

    Next

    ret = mySapModel.View.RefreshView

    'End If

    AreaNames_ = AreaNames
    A = ret
# ---------- addareascoord: VB additional code ----------
  Private Shared AreaNames As New List(Of String)
# ---------- end addareascoord ----------
getpts20 = VBScript(
    SapModel=getsap20.SapModel,
    run=mesh,
    Reference="C:\Program Files (x86)\Computers and Structures\SAP2000 20\SAP2000v20.dll")  # -> out, Pts, PtNames
# ---------- getpts20: VB ----------
    Dim mySapModel As csapmodel
    mySapModel = CType(_SapModel, cSapModel)
    Dim ret As Long

    Dim PtNameCount As Long
    Dim PtNames() As String : PtNames = Nothing



    ' - - - - - - - - - - - - - - - - - - - - - + - - - + - - - + - - - + - - - +
    'If run

      Pts.clear
      PtNamesList.Clear

      ret = mySapModel.PointObj.GetNameList(PtNameCount, PtNames)

      For i As Integer = 0 To PtNameCount - 1
        Dim x As Double : x = Nothing
        Dim y As Double : y = Nothing
        Dim z As Double : z = Nothing
        ret = mySapModel.PointObj.GetCoordCartesian(PtNames(i), x, y, z)
        Pts.add(New point3d(x, y, z))
        PtNamesList.add(PtNames(i))
      Next


    'End If

    Pts_ = Pts
    PtNames_ = PtNamesList
# ---------- getpts20: VB additional code ----------
  Private Shared Pts As New list(Of point3d)
  Private Shared PtNamesList As New list(Of String)
# ---------- end getpts20 ----------
cp_2 = ClosestPoint(Point=pt, Cloud=getpts20.Pts)  # -> ClosestPoint, CPIndex, Distance
rec = DataRecorder(addareascoord.out, DataLimit=-10, RecordData=True)
panel = Panel(addareascoord.AreaNames)
project = Project(Geometry=cp_2.ClosestPoint, Plane=PlaneXY(0, 0, 0))  # -> Geometry, Transform
item_6 = ListItem(List=getpts20.PtNames, Index=cp_2.CPIndex, Wrap=True)
ln = Line(StartPoint=cp_2.ClosestPoint, EndPoint=project.Geometry)
panel_2 = Panel(rec)
panel_3 = Panel("""true
true
true
false
false
false""")
setrestraint = VBScript(
    SapModel=getsap20.SapModel,
    PtNames=item_6,
    Restraint=panel_3,
    run=addareascoord.A,
    Reference="C:\Program Files (x86)\Computers and Structures\SAP2000 20\SAP2000v20.dll")  # -> out, A; inputs PtNames: list, Restraint: list
# ---------- setrestraint: VB ----------
    Dim mySapModel As csapmodel
    mySapModel = CType(_SapModel, cSapModel)
    Dim ret As Long


    ' - - - - - - - - - - - - - - - - - - - - - + - - - + - - - + - - - + - - - +
    'If run Then

    For i As Integer = 0 To _PtNames.count() - 1

      ret = mySapModel.PointObj.setRestraint(_PtNames(i), _Restraint.ToArray)
      print(ret)
    Next

    'End If

    A = ret
# ---------- end setrestraint ----------
panel_4 = Panel("C:\Users\DSegraves\Documents\_Docs\Present\AEC Tech Hackathon 2018\x.sdb")
runanalysis = VBScript(
    SapModel=getsap20.SapModel,
    saveloc=panel_4,
    run=setrestraint.A,
    Reference="C:\Program Files (x86)\Computers and Structures\SAP2000 20\SAP2000v20.dll")  # -> out, A
# ---------- runanalysis: VB ----------
    Dim mySapModel As csapmodel
    mySapModel = CType(_SapModel, cSapModel)
    Dim ret As Long

    ' - - - - - - - - - - - - - - - - - - - - - + - - - + - - - + - - - + - - - +
    'If run Then

    ret = mySapModel.File.Save(saveloc)

    ret = mySapModel.Analyze.RunAnalysis()
    print(ret)

    'End If

    A = ret
# ---------- end runanalysis ----------
panel_5 = Panel("5155")
areaforce = VBScript(
    SapModel=getsap20.SapModel,
    AreaNames=addareascoord.AreaNames,
    run=runanalysis.A,
    Reference="C:\Program Files (x86)\Computers and Structures\SAP2000 20\SAP2000v20.dll")  # -> out, MMax; inputs AreaNames: list
# ---------- areaforce: VB ----------
    Dim mySapModel As csapmodel
    mySapModel = CType(_SapModel, cSapModel)
    Dim ret As Long


    ' - - - - - - - - - - - - - - - - - - - - - + - - - + - - - + - - - + - - - +
    'If run Then
    _MMax.clear

    For i As Integer = 0 To _AreaNames.count() - 1

      Dim NumberResults As Long = Nothing
      Dim Obj() As String = Nothing
      Dim Elm() As String = Nothing
      Dim PointElm() As String = Nothing
      Dim LoadCase() As String = Nothing
      Dim StepType() As String = Nothing
      Dim StepNum() As Double = Nothing
      Dim F11() As Double = Nothing
      Dim F22() As Double = Nothing
      Dim F12() As Double = Nothing
      Dim FMax() As Double = Nothing
      Dim FMin() As Double = Nothing
      Dim FAngle() As Double = Nothing
      Dim FVM() As Double = Nothing
      Dim M11() As Double = Nothing
      Dim M22() As Double = Nothing
      Dim M12() As Double = Nothing
      Dim MMax() As Double = Nothing
      Dim MMin() As Double = Nothing
      Dim MAngle() As Double = Nothing
      Dim V13() As Double = Nothing
      Dim V23() As Double = Nothing
      Dim VMax() As Double = Nothing
      Dim VAngle() As Double = Nothing


      'ReDim Loadcase(1)
      'Loadcase(0) = "DEAD"

      ret = mySapModel.Results.Setup.SetCaseSelectedForOutput("DEAD")

      ret = mySapModel.Results.AreaForceShell(_AreaNames(i), 0, NumberResults, Obj, Elm, PointElm, LoadCase, StepType, StepNum, F11, F22, F12, FMax, FMin, FAngle, FVM, M11, M22, M12, MMax, MMin, MAngle, V13, V23, VMax, VAngle)


      print(ret)

      If mmax Is Nothing Then
      Else
        _MMax.add(MMax(0))
      End If


    Next

    'End If

    MMax_ = _MMax
# ---------- areaforce: VB additional code ----------
  Private Shared _MMax As New list(Of Double)
# ---------- end areaforce ----------
bnd = Bounds(Numbers=areaforce.MMax)
number_slider = Slider(0.504, range=0..1)
dedomain = DeconstructDomain(Domain=bnd)  # -> Start, End
multiplication_2 = Multiplication(A=dedomain.Start, B=number_slider)
multiplication_3 = Multiplication(A=dedomain.End, B=number_slider)
gradient = Gradient(
    LowerLimit=multiplication_2,
    UpperLimit=multiplication_3,
    Parameter=areaforce.MMax,
    stops=[0: RGB(234, 38, 0), 0.25: RGB(234, 126, 0), 0.5: RGB(254, 244, 84), 0.75: RGB(173, 203, 249), 1: RGB(75, 107, 169)])
panel_6 = Panel("-1500")
panel_7 = Panel("50000")
preview = CustomPreview(Geometry=flatten(srf4pt), Shader=gradient)
