# Grasshopper definition add run.gh (Grasshopper 0.9.76)

panel = Panel("C:\Users\DSegraves\Documents\_Docs\Present\AEC Tech Hackathon 2018\x.sdb")
runanalysis = VBScript(saveloc=panel, Reference="C:\Program Files (x86)\Computers and Structures\SAP2000 20\SAP2000v20.dll")  # -> out, A
# ---------- runanalysis: VB ----------
    Dim mySapModel As csapmodel
    mySapModel = CType(_SapModel, cSapModel)
    Dim ret As Long

    ' - - - - - - - - - - - - - - - - - - - - - + - - - + - - - + - - - + - - - +
    'If run Then

    ret = mySapModel.File.Save(saveloc)

    ret = mySapModel.Analyze.RunAnalysis()
    print(ret)

    'End If

    A = ret
# ---------- end runanalysis ----------
